# Dynamo graph Browser Organization_Duplicate Views.dyn (Dynamo 2.13.1.3887)
# packages: Bakery 2019.5.8, archi-lab.net 2016.13.1

get_all_views = Custom[Get All Views]()  # package Bakery; taken from archi-lab
list_create = List.Create(item0=get_all_views.Floor_Plans, item1=get_all_views.3D_Views)
# note: Hi All ,Prem Talreja here
# Before using this scripts you have to follow below mentioned steps:
# - Create new "View Type" project parameter for views
# - Set your browser organization by View name and than view type and family & Type.
# Use this script for duplicate views and after that use rename script.
# if you have any queries contact me on : premtalreja7@gmail.com
flatten = List.Flatten(list=list_create)
code_block = CodeBlock { "View Name"; }
getParameterValueByName = Element.GetParameterValueByName(element=flatten, parameterName=code_block)
code_block_2 = CodeBlock { " copy "; }
code_block_3 = CodeBlock { 1..6; }
flatten_2 = List.Flatten(list=code_block_3)
add = code_block_2 + flatten_2
add_2 = getParameterValueByName + add  # lacing=CrossProduct
view_duplicate_options = ViewDuplicateOptions("WithDetailing")
duplicate = Archilab.Grimshaw.Views.View.Duplicate(view=flatten, name=add_2, options=view_duplicate_options)
code_block_4 = CodeBlock { "View Type"; }
code_block_5 = CodeBlock { "01_Working View"; }
setParameterByName = Element.SetParameterByName(element=flatten, parameterName=code_block_4, value=code_block_5)
