# Dynamo graph Browser Organization_Renaming Views.dyn (Dynamo 2.13.1.3887)
# packages: Bakery 2019.5.8, archi-lab.net 2020.23.12

# note: Hi, This is Prem Talreja.
# Firstl run my "duplicate views" script and than run this,
# Feel free to contact me on:
# Linkedin - www.linkedin.com/in/prem-talreja
# Mail - premtalreja7@gmail.com

get_all_views = Custom[Get All Views]()  # package Bakery; taken from archi-lab
list_create = List.Create(item0=get_all_views.Floor_Plans, item1=get_all_views.3D_Views)
flatten = List.Flatten(list=list_create)

# group: SHEET VIEW
code_block = CodeBlock { "View Name"; }
getParameterValueByName = Element.GetParameterValueByName(element=flatten, parameterName=code_block)
flatten_2 = List.Flatten(list=getParameterValueByName)
code_block_2 = CodeBlock { "copy 1"; }
boolean = BoolSelector(true)
contains = String.Contains(string=flatten_2, searchFor=code_block_2, ignoreCase=boolean)
filterByBoolMask = List.FilterByBoolMask(list=flatten, mask=contains)
filterByBoolMask_2 = List.FilterByBoolMask(list=flatten_2, mask=contains)
code_block_3 = CodeBlock { "Sheet View"; }
replace = String.Replace(string=filterByBoolMask_2.in, searchFor=code_block_2, replaceWith=code_block_3)
setParameterByName = Element.SetParameterByName(element=filterByBoolMask.in, parameterName=code_block, value=replace)
code_block_4 = CodeBlock { "View Type"; }
code_block_5 = CodeBlock { "02_Sheet View"; }
setParameterByName_2 = Element.SetParameterByName(element=setParameterByName, parameterName=code_block_4, value=code_block_5)
relay = Relay()  # unwired: arg0

# group: NAVISWORKS VIEW
code_block_6 = CodeBlock { "View Name"; }
getParameterValueByName_2 = Element.GetParameterValueByName(element=flatten, parameterName=code_block_6)
flatten_3 = List.Flatten(list=getParameterValueByName_2)
code_block_7 = CodeBlock { "copy 2"; }
boolean_2 = BoolSelector(true)
contains_2 = String.Contains(string=flatten_3, searchFor=code_block_7, ignoreCase=boolean_2)
filterByBoolMask_3 = List.FilterByBoolMask(list=flatten, mask=contains_2)
filterByBoolMask_4 = List.FilterByBoolMask(list=flatten_3, mask=contains_2)
code_block_8 = CodeBlock { "Navis Export View"; }
replace_2 = String.Replace(string=filterByBoolMask_4.in, searchFor=code_block_7, replaceWith=code_block_8)
setParameterByName_3 = Element.SetParameterByName(element=filterByBoolMask_3.in, parameterName=code_block_6, value=replace_2)
code_block_9 = CodeBlock { "View Type"; }
code_block_10 = CodeBlock { "03_Navisworks View"; }
setParameterByName_4 = Element.SetParameterByName(element=setParameterByName_3, parameterName=code_block_9, value=code_block_10)
relay_2 = Relay()  # unwired: arg0

# group: COORDINATION VIEW
code_block_11 = CodeBlock { "View Name"; }
getParameterValueByName_3 = Element.GetParameterValueByName(element=flatten, parameterName=code_block_11)
flatten_4 = List.Flatten(list=getParameterValueByName_3)
code_block_12 = CodeBlock { "copy 3"; }
boolean_3 = BoolSelector(true)
contains_3 = String.Contains(string=flatten_4, searchFor=code_block_12, ignoreCase=boolean_3)
filterByBoolMask_5 = List.FilterByBoolMask(list=flatten, mask=contains_3)
filterByBoolMask_6 = List.FilterByBoolMask(list=flatten_4, mask=contains_3)
code_block_13 = CodeBlock { "Coordination View"; }
replace_3 = String.Replace(string=filterByBoolMask_6.in, searchFor=code_block_12, replaceWith=code_block_13)
setParameterByName_5 = Element.SetParameterByName(element=filterByBoolMask_5.in, parameterName=code_block_11, value=replace_3)
code_block_14 = CodeBlock { "View Type"; }
code_block_15 = CodeBlock { "04_Coordination View"; }
setParameterByName_6 = Element.SetParameterByName(element=setParameterByName_5, parameterName=code_block_14, value=code_block_15)
relay_3 = Relay()  # unwired: arg0

# group: QC VIEW
code_block_16 = CodeBlock { "View Name"; }
getParameterValueByName_4 = Element.GetParameterValueByName(element=flatten, parameterName=code_block_16)
flatten_5 = List.Flatten(list=getParameterValueByName_4)
code_block_17 = CodeBlock { "copy 6"; }
boolean_4 = BoolSelector(true)
contains_4 = String.Contains(string=flatten_5, searchFor=code_block_17, ignoreCase=boolean_4)
filterByBoolMask_7 = List.FilterByBoolMask(list=flatten, mask=contains_4)
filterByBoolMask_8 = List.FilterByBoolMask(list=flatten_5, mask=contains_4)
code_block_18 = CodeBlock { "QC View"; }
replace_4 = String.Replace(string=filterByBoolMask_8.in, searchFor=code_block_17, replaceWith=code_block_18)
setParameterByName_7 = Element.SetParameterByName(element=filterByBoolMask_7.in, parameterName=code_block_16, value=replace_4)
code_block_19 = CodeBlock { "View Type"; }
code_block_20 = CodeBlock { "07_QC View"; }
setParameterByName_8 = Element.SetParameterByName(element=setParameterByName_7, parameterName=code_block_19, value=code_block_20)
relay_4 = Relay()  # unwired: arg0

# group: CALLOUT VIEW
relay_5 = Relay()  # unwired: arg0
code_block_21 = CodeBlock { "View Name"; }
getParameterValueByName_5 = Element.GetParameterValueByName(element=flatten, parameterName=code_block_21)
flatten_6 = List.Flatten(list=getParameterValueByName_5)
code_block_22 = CodeBlock { "copy 5"; }
boolean_5 = BoolSelector(true)
contains_5 = String.Contains(string=flatten_6, searchFor=code_block_22, ignoreCase=boolean_5)
filterByBoolMask_9 = List.FilterByBoolMask(list=flatten, mask=contains_5)
filterByBoolMask_10 = List.FilterByBoolMask(list=flatten_6, mask=contains_5)
code_block_23 = CodeBlock { "Callout View"; }
replace_5 = String.Replace(string=filterByBoolMask_10.in, searchFor=code_block_22, replaceWith=code_block_23)
setParameterByName_9 = Element.SetParameterByName(element=filterByBoolMask_9.in, parameterName=code_block_21, value=replace_5)
code_block_24 = CodeBlock { "View Type"; }
code_block_25 = CodeBlock { "06_Callout View"; }
setParameterByName_10 = Element.SetParameterByName(element=setParameterByName_9, parameterName=code_block_24, value=code_block_25)

# group: PRESENTATION VIEW
relay_6 = Relay()  # unwired: arg0
code_block_26 = CodeBlock { "View Name"; }
getParameterValueByName_6 = Element.GetParameterValueByName(element=flatten, parameterName=code_block_26)
flatten_7 = List.Flatten(list=getParameterValueByName_6)
code_block_27 = CodeBlock { "copy 4"; }
boolean_6 = BoolSelector(true)
contains_6 = String.Contains(string=flatten_7, searchFor=code_block_27, ignoreCase=boolean_6)
filterByBoolMask_11 = List.FilterByBoolMask(list=flatten, mask=contains_6)
filterByBoolMask_12 = List.FilterByBoolMask(list=flatten_7, mask=contains_6)
code_block_28 = CodeBlock { "Presentation View"; }
replace_6 = String.Replace(string=filterByBoolMask_12.in, searchFor=code_block_27, replaceWith=code_block_28)
setParameterByName_11 = Element.SetParameterByName(element=filterByBoolMask_11.in, parameterName=code_block_26, value=replace_6)
code_block_29 = CodeBlock { "View Type"; }
code_block_30 = CodeBlock { "05_Presentation View"; }
setParameterByName_12 = Element.SetParameterByName(element=setParameterByName_11, parameterName=code_block_29, value=code_block_30)
