# Dynamo graph C2B_Drawing to Pipe.dyn "Drawing to Pipe" (Dynamo 2.3.0.5885)
# packages: MEPover 2019.12.1, bimorphNodes 5.1.3

# group: Contact
# note: Contact premtalreja7@gmail.com in case of queries

select_model_element = DSModelElementSelection()  # 1 picked in the model
layer_name = CodeBlock { "FPW SPR"; }
curvesFromCADLayers = CAD.CurvesFromCADLayers(importInstance=select_model_element, layerNames=layer_name)
flatten = List.Flatten(list=curvesFromCADLayers.Curve)
element_types = ElementTypes("PipeType")  # graph input
all_elements_of_type = ElementsOfType(element_type=element_types)
code_block = CodeBlock { 0; }
getItemAtIndex = List.GetItemAtIndex(list=all_elements_of_type, index=code_block)
element_types_2 = ElementTypes("PipingSystemType")  # graph input
all_elements_of_type_2 = ElementsOfType(element_type=element_types_2)
code_block_2 = CodeBlock { 5; }
getItemAtIndex_2 = List.GetItemAtIndex(list=all_elements_of_type_2, index=code_block_2)
levels = Levels("Level 1")  # graph input
code_block_3 = CodeBlock { 50; }
byLines = Custom[Pipe.ByLines](Lines=flatten, PipeType=getItemAtIndex, SystemType=getItemAtIndex_2, level=levels, Diameter=code_block_3)  # package MEPover; Creates a pipe by Line, PipeType, SystemType, Level and Diameter
byMEPCurves = Custom[Elbow.ByMEPCurves]()  # package MEPover; Takes in a list of MEPCurves (pipe, duct, cable tray, conduit) and will attempt to create elbows where possible. A margin can be entered for max distance between connectors; unwired: MEPCurves
by2MEPCurves = Custom[Tap.By2MEPCurves]()  # package MEPover; Create a new TakeoffFitting or Tap by takeoff pipe and through pipe; unwired: Branch_MEPCurve, Main_MEPCurve
