# Dynamo graph CAD Block to Revit Family.dyn (Dynamo 2.3.0.5885)
# packages: Genius Loci 2021.11.10

family_types = FamilyTypes("M_Rectangular Elbow - Mitered:Standard")
select_model_element = DSModelElementSelection()  # 1 picked in the model
# note: Created By Prem Talreja - Contact - premtalreja7@gmail.com for any queries
cad_block = Custom[CAD Block](importInstance=select_model_element)  # package Genius Loci; Get the location point, name and layer of the CAD blocks / XRefs from a CAD link or import. Please note : The non-uniform scaling of blocks is not supported (The X, Y and Z values ​​of the Block Scale must be the same).
code_block = CodeBlock(t1=cad_block.BlockName) { t2 = DSCore.List.Flatten(t1, -1); }
string_from_object = FromObject(obj=code_block)
string = StringInput("M-PLOT A-B7-FA$0$SDV")
contains = String.Contains(str=string_from_object, searchFor=string)
filterByBoolMask = List.FilterByBoolMask(list=cad_block.OriginPoint, mask=contains)
levels = Levels("Level 1")
byPointAndLevel = FamilyInstance.ByPointAndLevel(familyType=family_types, point=filterByBoolMask.in, level=levels)
