# Dynamo graph COBie Set1.dyn (Dynamo 2.3.0.5885)
# packages: Golden Eagle 2022.3.15

select_model_elements = DSModelElementsSelection()  # 3 picked in the model
COBieComponentDescription = Custom[COBieComponentDescription](Elements=select_model_elements)  # package Golden Eagle; Fill up COBie.Component.Description by this code, Make sure COBie.Component.Name filled.
COBieCreatedOn = Custom[COBieCreatedOn](Elements=select_model_elements)  # package Golden Eagle; COBie.CreatedOn data fill live date and time on parameter
COBieSerialNumber = Custom[COBieSerialNumber](Elements=select_model_elements)  # package Golden Eagle; Set Serial Number by selecting elements
COBieTypeCategory = Custom[COBieTypeCategory](Element=select_model_elements)  # package Golden Eagle; Fill type category by selecting elements.
COBieTypeName = Custom[COBieTypeName](Element=select_model_elements)  # package Golden Eagle; Fill Element Name by Selecting Elements
