# Dynamo graph Clash Isolate from Navis Report(Prem Talreja Script_21).dyn "Navisworks Clashes Isolate" (Dynamo 2.3.0.5885)
# packages: BumbleBee 2021.25.2, archi-lab.net 2020.23.12

file_path = Filename("D:\LINKEDINPOSTS\Navisworks to Revit Clash isolate\HVAC x FPW.xlsx")
boolean = BoolSelector(true)
code_block = CodeBlock { "HVAC x FPW"; }
read_excel = Custom[Read Excel](filePath=file_path, runIt=boolean, sheetName=code_block)  # package BumbleBee; This node will read an excel file. You can read an entore sheet contents, read from specific origin cell, read only specific range, or do all of the former for multiple sheets at the same time.
transpose = List.Transpose(lists=read_excel)
code_block_2 = CodeBlock { 0; }
getItemAtIndex = List.GetItemAtIndex(list=transpose, index=code_block_2)
isNull = Object.IsNull(obj=getItemAtIndex)
filterByBoolMask = List.FilterByBoolMask(list=getItemAtIndex, mask=isNull)
string_from_object = FromObject(obj=filterByBoolMask.out)
code_block_3 = CodeBlock { 0; }
code_block_4 = CodeBlock { 12; }
remove = String.Remove(str=string_from_object, startIndex=code_block_3, count=code_block_4)
byElementId = archilab.Revit.Selection.Select.ByElementId(id=remove)
views = Views("{3D - Prem} Copy 1")
isolate_in_view = Custom[Isolate in View](element=byElementId, view=views)  # package archi-lab.net; This node will take input of elements and a view to isolate selected elements in a view.
code_block_5 = CodeBlock { 0; 255; }
byARGB = Color.ByARGB(a=code_block_5.out1, r=code_block_5.out1, g=code_block_5.out0, b=code_block_5.out0)
overrideColorInView = Element.OverrideColorInView(element=isolate_in_view, color=byARGB)
