# Dynamo graph Delete Imported CAD.dyn "Imported CAD_Delete" (Dynamo 2.3.0.5885)

# note: Contact - premtalreja7@gmail.com for any queries
boolean = BoolSelector(true)
getCadLinked = CAD.CADLinked.GetCadLinked(fresh=boolean)
delete = Element.Delete(element=getCadLinked.importinstance)
