# Dynamo graph Dyn_html Clashes Isolate_By Prem Talreja.dyn "Dyn_html Clashes Isolate" (Dynamo 2.13.1.3887)

boolean = BoolSelector(true)
# note: Script Function : Isolate Clash Elements in View
# Script Create By : Prem Talreja
# Contact : premtalreja7@gmail.com
# LinkedIn : https://www.linkedin.com/in/prem-talreja/
file_path = Filename("C:\Users\premt\OneDrive\Desktop\RME_basic_sample_project.xlsx")  # graph input
file_from_path = FileObject(path=file_path)
sheet_name_in_excel_file = StringInput("RME_basic_sample_project")  # graph input
importExcel = Data.ImportExcel(file=file_from_path, sheetName=sheet_name_in_excel_file)
transpose = List.Transpose(lists=importExcel)
flatten = List.Flatten(list=transpose)
isNull = Object.IsNull(object=flatten)
filterByBoolMask = List.FilterByBoolMask(list=flatten, mask=isNull)
string_from_object = FromObject(obj=filterByBoolMask.out)
code_block = CodeBlock { "id "; }
split = String.Split(string=string_from_object, separator0=code_block)
transpose_2 = List.Transpose(lists=split)
code_block_2 = CodeBlock { 1; }
getItemAtIndex = List.GetItemAtIndex(list=transpose_2, index=code_block_2)
isNull_2 = Object.IsNull(object=getItemAtIndex)
filterByBoolMask_2 = List.FilterByBoolMask(list=getItemAtIndex, mask=isNull_2)
element_by_id = ElementById(Id=filterByBoolMask_2.out)
code_block_3 = CodeBlock { 0; 255; }
byARGB = Color.ByARGB(alpha=code_block_3.out1, red=code_block_3.out1, green=code_block_3.out0, blue=code_block_3.out0)
overrideColorInView = Element.OverrideColorInView(element=element_by_id, color=byARGB)
code_block_4 = CodeBlock { 1; }
dropItems = List.DropItems(list=string_from_object, amount=code_block_4)
views = Views("{3D}")  # graph input
isolateElementsTemporary = View.IsolateElementsTemporary(view=views, elements=element_by_id)
