# Dynamo graph Elements Level Change.dyn (Dynamo 2.3.0.5885)
# packages: Genius Loci 2021.11.10

select_model_elements = DSModelElementsSelection()  # 7 picked in the model
levels = Levels("Level 2")
element_change_level = Custom[Element Change Level](element=select_model_elements, level=levels)  # package Genius Loci; Change the element to the selected level without moving the element. Doesn't work with hosted family (Wall Based) and Work Plane based family (without Reference Level or with read-only Schedule Level).
