# Dynamo graph Elements in room by dynamo.dyn (Dynamo 2.1.0.7500)

# group: Script Information
# note: CREATED BY: Chirag Savaliya
# CREATED: 24/10/2024
# VERSION: V 0.1
# LAST EDITED: 24/10/2024
# DYNAMO VERSION: It supports all Dynamo Versions in Revit 2020 to Present.
# PACKAGES:
# BimrophNodes
# Archilab
# DynaMEP
# NOTES:
# Use this script on 3d view to tall all elements
# Contect: Savaliya.chirag1998@gmail.com

# group: Element Parameter
parameter = StringInput("Comments")  # graph input

# group: Element Collector
select_elements = Python()  # unwired: IN[0]
# ---------- select_elements.python (58 lines) ----------
import clr
clr.AddReference('RevitAPI')
from Autodesk.Revit.DB import *
clr.AddReference('RevitServices')
from RevitServices.Persistence import DocumentManager

# Get the current document
doc = DocumentManager.Instance.CurrentDBDocument

# Get the active view
active_view = doc.ActiveView

# Define the categories to exclude
excluded_categories = [
    BuiltInCategory.OST_Walls, 
    BuiltInCategory.OST_Floors,
    BuiltInCategory.OST_Doors,
    BuiltInCategory.OST_Windows,
    BuiltInCategory.OST_Roofs,
    BuiltInCategory.OST_Rooms,
    BuiltInCategory.OST_ElevationMarks,
    BuiltInCategory.OST_Views,
    BuiltInCategory.OST_CurtainWallPanels,
    BuiltInCategory.OST_GbXML_Opening,
    BuiltInCategory.OST_ShaftOpening,
    BuiltInCategory.OST_ArcWallRectOpening,
    BuiltInCategory.OST_CeilingOpening,
    BuiltInCategory.OST_FloorOpening,
    BuiltInCategory.OST_RoofOpening,
    BuiltInCategory.OST_DoorsOpeningCut,
    BuiltInCategory.OST_WindowsOpeningCut,
    BuiltInCategory.OST_CurtainWallMullions
    
      
]

# Initialize a list to hold the selected elements
selected_elements = []

# Create a FilteredElementCollector to get all elements in the current view
collector = FilteredElementCollector(doc, active_view.Id)

# Collect all elements and filter out the excluded categories
for element in collector:
    if element.Category is not None:
        # Compare the element's category Id with the excluded categories
        if element.Category.Id not in [ElementId(cat) for cat in excluded_categories]:
            # Check if the bounding box is not null
            bounding_box = element.get_BoundingBox(active_view)
            if bounding_box is not None:
                # Ensure the bounding box has valid dimensions
                if (bounding_box.Max.X > bounding_box.Min.X and
                    bounding_box.Max.Y > bounding_box.Min.Y and
                    bounding_box.Max.Z > bounding_box.Min.Z):
                    selected_elements.append(element)

# Output the list of selected elements with valid bounding boxes
OUT = selected_elements
# ----------------------------------------
model_elements = Python(IN[0]=select_elements, IN[1]=parameter)
# ---------- model_elements.python (36 lines) ----------
import clr
clr.AddReference('RevitAPI')
from Autodesk.Revit.DB import *
clr.AddReference('RevitServices')
from RevitServices.Persistence import DocumentManager

# Get the current document
doc = DocumentManager.Instance.CurrentDBDocument

# Unwrap the input elements from the user
input_elements = UnwrapElement(IN[0]) if isinstance(IN[0], list) else [UnwrapElement(IN[0])]

parameter_name = IN[1]

# Initialize a list to hold the selected elements
selected_elements = []

# Iterate through the input elements and check their bounding boxes
for element in input_elements:
    if element is not None:
        # Check if the bounding box is valid
        bounding_box = element.get_BoundingBox(None)  # None for global coordinates
        if bounding_box is not None:
            # Ensure the bounding box has valid dimensions
            if (bounding_box.Max.X > bounding_box.Min.X and
                bounding_box.Max.Y > bounding_box.Min.Y and
                bounding_box.Max.Z > bounding_box.Min.Z):
             
                
                    # Check if the element has the specified parameter
                param = element.LookupParameter(parameter_name)
                if param is not None:  # Element has the parameter
                    selected_elements.append(element)

# Output the list of selected elements with valid bounding boxes
OUT = selected_elements
# ----------------------------------------

# group: Get Rooms
categories = Categories("OST_Rooms")
all_elements_of_category = ElementsOfCategory(Category=categories)

# group: Room Information
boundingBox = Element.BoundingBox(element=all_elements_of_category)
name = Room.Name(room=all_elements_of_category)

code_block = CodeBlock { 1; }

# group: Vector information
maxPoint = BoundingBox.MaxPoint(boundingBox=boundingBox)
Z = Point.Z(point=maxPoint)
byCoordinates = Vector.ByCoordinates(z=Z)
minPoint = BoundingBox.MinPoint(boundingBox=boundingBox)
Z_2 = Point.Z(point=minPoint)
code_block_2 = CodeBlock { 0; }
code_block_3 = CodeBlock(a=Z_2, b=code_block_2) { a==b; }
if_ = If(test=code_block_3, true=code_block, false=Z_2)
byCoordinates_2 = Vector.ByCoordinates(z=if_)

# group: To get mid point of Element
boundingBox_2 = Element.BoundingBox(element=model_elements)
minPoint_2 = BoundingBox.MinPoint(boundingBox=boundingBox_2)
X = Point.X(point=minPoint_2)
maxPoint_2 = BoundingBox.MaxPoint(boundingBox=boundingBox_2)
X_2 = Point.X(point=maxPoint_2)
code_block_4 = CodeBlock(a=X, b=X_2) { (a+b)/2; }
Y = Point.Y(point=minPoint_2)
Y_2 = Point.Y(point=maxPoint_2)
code_block_5 = CodeBlock(a=Y, b=Y_2) { (a+b)/2; }
Z_3 = Point.Z(point=minPoint_2)
Z_4 = Point.Z(point=maxPoint_2)
code_block_6 = CodeBlock(a=Z_3, b=Z_4) { (a+b)/2; }
byCartesianCoordinates = Point.ByCartesianCoordinates(x=code_block_4, y=code_block_5, z=code_block_6)

# group: Geometry Intersect
coreBoundary = Room.CoreBoundary(room=all_elements_of_category)
code_block_7 = CodeBlock { 0; }
getItemAtIndex = List.GetItemAtIndex(list=coreBoundary@L3, index=code_block_7)
byJoinedCurves = PolyCurve.ByJoinedCurves(curves=getItemAtIndex@L2)
extrudeAsSolid = Curve.ExtrudeAsSolid(curve=byJoinedCurves@L2, direction=byCoordinates)
extrudeAsSolid_2 = Curve.ExtrudeAsSolid(curve=byJoinedCurves@L2, direction=byCoordinates_2)
union = Solid.Union(solid=extrudeAsSolid, solid_2=extrudeAsSolid_2)
flatten = List.Flatten(list=union)
doesIntersect = Geometry.DoesIntersect(geometry=flatten@L1, other=byCartesianCoordinates)

# group: Information Process
flatten_2 = List.Flatten(list=model_elements)
filterByBoolMask = List.FilterByBoolMask(list=flatten_2@L2, mask=doesIntersect@L2, lacing=Longest)
watch = Watch(filterByBoolMask.in)

# group: Set room name to Elements
setParameterByName = Element.SetParameterByName(element=watch, parameterName=parameter, value=name)
