# Dynamo graph Get&Set Parameter Value.dyn (Dynamo 2.3.0.5885)

select_model_elements = DSModelElementsSelection()  # nothing selected
string = StringInput("")
string_2 = StringInput("")
# note: Contact premtalreja7@gmail.com in case of queries
getParameterValueByName = Element.GetParameterValueByName(element=select_model_elements, parameterName=string_2)
string_from_object = FromObject(obj=getParameterValueByName)
setParameterByName = Element.SetParameterByName(element=select_model_elements, parameterName=string, value=string_from_object)
