# Dynamo graph Identical Instances in the Same Place.dyn (Dynamo 2.13.1.3887)
# packages: DiRoots 2018.3.5

# group: Identical Instances in Same Place Warning Resolve
# note: Contact - premtalreja7@gmail.com for any queries

getWarnings = DiRoots.QA.Alerts.GetWarnings()
code_block = CodeBlock { "There are identical instances in the same place"; }
contains = String.Contains(string=getWarnings.FailureMessageDescription, searchFor=code_block)
filterByBoolMask = List.FilterByBoolMask(list=getWarnings.FailingElements, mask=contains)
code_block_2 = CodeBlock { 0; }
getItemAtIndex = List.GetItemAtIndex(list=filterByBoolMask.in@L2, index=code_block_2)
delete = Element.Delete(element=getItemAtIndex)
