# Dynamo graph Import Excel- Remove Null Data.dyn (Dynamo 2.3.0.5885)
# packages: Golden Eagle 2022.3.15

importFromExcel = Custom[ImportFromExcel]()  # package Golden Eagle; Data Import from excel without any null or empty data.; unwired: filePath
file_path = Filename("No file selected.")
# note: Contact premtalreja7@gmail.com in case of queries
file_from_path = FileObject(path=file_path)
string = StringInput("Sheet1")
importExcel = Data.ImportExcel(file=file_from_path, sheetName=string)
flatten = List.Flatten(list=importExcel)
isNull = Object.IsNull(obj=flatten)
filterByBoolMask = List.FilterByBoolMask(list=flatten, mask=isNull)
flatten_2 = List.Flatten(list=filterByBoolMask.in)
