# Dynamo graph Isolate Clash Element from Navis Report.dyn "Clash Isolate from Navis Report(Prem Talreja Script_21)" (Dynamo 2.3.0.5885)
# packages: archi-lab.net 2020.23.12

code_block = CodeBlock { 0; 255; }
byARGB = Color.ByARGB(a=code_block.out1, r=code_block.out1, g=code_block.out0, b=code_block.out0)
overrideColorInView = Element.OverrideColorInView(color=byARGB)  # unwired: element
file_path = Filename("D:\LINKEDINPOSTS\Navisworks to Revit Clash isolate\HVAC x FPW.xlsx")
code_block_2 = CodeBlock { "HVAC x FPW"; }
importFromExcel = Custom[ImportFromExcel](filePath=file_path, sheetName=code_block_2)  # Data Import from excel without any null or empty data.
transpose = List.Transpose(lists=importFromExcel)
isNull = Object.IsNull(obj=transpose)
filterByBoolMask = List.FilterByBoolMask(list=transpose, mask=isNull)
string_from_object = FromObject(obj=filterByBoolMask.out)
code_block_3 = CodeBlock { 0; }
code_block_4 = CodeBlock { 12; }
remove = String.Remove(str=string_from_object, startIndex=code_block_3, count=code_block_4)
byElementId = archilab.Revit.Selection.Select.ByElementId(id=remove)
isNull_2 = Object.IsNull(obj=byElementId)
filterByBoolMask_2 = List.FilterByBoolMask(list=byElementId, mask=isNull_2)
views = Views("{3D}")  # graph input
isolate_in_view = Custom[Isolate in View](element=filterByBoolMask_2.out, view=views)  # package archi-lab.net; This node will take input of elements and a view to isolate selected elements in a view.
