# Dynamo graph Join Geometry From Interference Check.dyn "Join_ Geometry_ From_ Interference_ Check" (Dynamo 2.13.1.3887)
# packages: Synthesize toolkit 24.10.2101

# group: Join_ Geometry_ From_ Interference_ Check
# note: Contact - premtalreja7@gmail.com for any queries

file_path = Filename(".\Project1.html")  # graph input
k_interference_check = Custom[K-Interference Check](VARReport=file_path)  # package Synthesize toolkit; K-Interference Check
transpose = List.Transpose(lists=k_interference_check.VARAffectedElements)
code_block = CodeBlock { 0; }
getItemAtIndex = List.GetItemAtIndex(list=transpose, index=code_block)
code_block_2 = CodeBlock { 1; }
getItemAtIndex_2 = List.GetItemAtIndex(list=transpose, index=code_block_2)
joinGeometry = Element.JoinGeometry(element=getItemAtIndex, otherElement=getItemAtIndex_2)
