# Dynamo graph MEPF Fixture Alighnment to Ceiling.dyn "Ceiling Alignment" (Dynamo 2.3.0.5885)
# packages: bimorphNodes 5.1.3

select_model_elements = DSModelElementsSelection()  # 11 picked in the model
code_block = CodeBlock { "Elevation from Level"; }
getLocation = Element.GetLocation(element=select_model_elements)
code_block_2 = CodeBlock { 2000; }
byCenterPointRadius = Sphere.ByCenterPointRadius(centerPoint=getLocation, radius=code_block_2)
categories = Categories("OST_Ceilings")
all_elements_of_category = ElementsOfCategory(Category=categories)
intersectsSolid = Revit.Element.IntersectsSolid(solids=byCenterPointRadius, elements=all_elements_of_category)
intersectingElements = Results.SolidIntersectionResult.IntersectingElements(solidIntersectionResult=intersectsSolid)
transpose = List.Transpose(lists=intersectingElements)
code_block_3 = CodeBlock { 0; }
getItemAtIndex = List.GetItemAtIndex(list=transpose, index=code_block_3)
code_block_4 = CodeBlock { "Height Offset From Level"; }
getParameterValueByName = Element.GetParameterValueByName(element=getItemAtIndex, parameterName=code_block_4)
setParameterByName = Element.SetParameterByName(element=select_model_elements, parameterName=code_block, value=getParameterValueByName)
