# Dynamo graph MEPF Sleeve Cut Opening of Round Objects_By Prem Talreja.dyn (Dynamo 2.13.1.3887)
# packages: Synthesize toolkit 24.10.2101, spring nodes 203.2.0

family_types = FamilyTypes("MEPF Sleeve Family:MEPF Sleeve Family")  # graph input
interference_file = Filename("..\P1.html")  # graph input
# note: Script By - Prem Talreja
# Contact- premtalreja7@gmail.com
# Script Function: MEPF Cut Openings
# Reachout me in case of queries
k_interference_check = Custom[K-Interference Check](VARReport=interference_file)  # package Synthesize toolkit; K-Interference Check
code_block = CodeBlock { 1; }
getItemAtIndex = List.GetItemAtIndex(list=k_interference_check.VARAffectedElements@L2, index=code_block)
code_block_2 = CodeBlock { 0; }
getItemAtIndex_2 = List.GetItemAtIndex(list=k_interference_check.VARAffectedElements@L2, index=code_block_2)
code_block_3 = CodeBlock { "Diameter"; }
getParameterValueByName = Element.GetParameterValueByName(element=getItemAtIndex_2, parameterName=code_block_3)
string_from_object = FromObject(obj=getParameterValueByName)
length = String.Length(string=string_from_object)
code_block_4 = CodeBlock { 0; }
eq = length == code_block_4
filterByBoolMask = List.FilterByBoolMask(list=getItemAtIndex, mask=eq)
faces = Element.Faces(element=filterByBoolMask.out)
perimeter = Surface.Perimeter(surface=faces)
maximumItem = List.MaximumItem(list=perimeter)
indexOf = List.IndexOf(list=perimeter@L2, element=maximumItem@L1)
getItemAtIndex_3 = List.GetItemAtIndex(list=faces@L2, index=indexOf@L1)
filterByBoolMask_2 = List.FilterByBoolMask(list=getItemAtIndex_2, mask=eq)
boundingBox = Element.BoundingBox(element=filterByBoolMask_2.out)
ꟿ_boundingbox_midpoint = Custom[ꟿ BoundingBox.MidPoint](boundingBox=boundingBox)  # package spring nodes; Fetches the mid point of the bounding box.
ꟿ_surface_outerperimetercurves = Custom[ꟿ Surface.OuterPerimeterCurves](surf=getItemAtIndex_3)  # package spring nodes; Get only the outer perimeter of a surface, dropping the inner openings.
byJoinedCurves = PolyCurve.ByJoinedCurves(curves=ꟿ_surface_outerperimetercurves)
planeAtParameter = Curve.PlaneAtParameter(curve=byJoinedCurves)
normal = Plane.Normal(plane=planeAtParameter)
byFace = FamilyInstance.ByFace(familyType=family_types, face=getItemAtIndex_3, location=ꟿ_boundingbox_midpoint, referenceDirection=normal)
radius_parameter = StringInput("Diameter")
code_block_5 = CodeBlock { "Diameter"; }
getParameterValueByName_2 = Element.GetParameterValueByName(element=filterByBoolMask_2.out, parameterName=code_block_5)
number_from_feet_and_inches = LengthFromString(Value=0.0254)
code_block_6 = CodeBlock(A=getParameterValueByName_2, B=number_from_feet_and_inches) { (A/12)+B; }
setParameterByName = Element.SetParameterByName(element=byFace, parameterName=radius_parameter, value=code_block_6)
