# Dynamo graph Overalp Elements Warning Resolved.dyn "Overalp_ Elements_ Warning_Resolved_ By_Dynamo" (Dynamo 2.13.1.3887)
# packages: DiRoots 2018.3.5, archi-lab.net 2016.13.1

# group: Overalp_ Elements_ Warning
# note: For any Queries Contact - premtalreja7@gmail.com

getWarnings = DiRoots.QA.Alerts.GetWarnings()
code_block = CodeBlock { "overlap"; }
contains = String.Contains(string=getWarnings.FailureMessageDescription, searchFor=code_block)
filterByBoolMask = List.FilterByBoolMask(list=getWarnings.FailingElements, mask=contains)
code_block_2 = CodeBlock { 1; }
getItemAtIndex = List.GetItemAtIndex(list=filterByBoolMask.in@L2, index=code_block_2)
delete = Archilab.Grimshaw.Elements.Element.Delete(element=getItemAtIndex)
