# Dynamo graph PREM TALREJA SCRIPT-30(Automate Placing(1)).dyn (Dynamo 2.3.0.5885)
# packages: Genius Loci 2021.11.10

family_types = FamilyTypes()  # nothing selected
select_model_elements = DSModelElementsSelection()  # 1 picked in the model
cad_block = Custom[CAD Block](importInstance=select_model_elements)  # package Genius Loci; Get the location point, name and layer of the CAD blocks / XRefs from a CAD link or import. Please note : The non-uniform scaling of blocks is not supported (The X, Y and Z values ​​of the Block Scale must be the same).
code_block = CodeBlock(t1=cad_block.BlockName) { t2 = DSCore.List.Flatten(t1, -1); }
string_from_object = FromObject(obj=code_block)
code_block_2 = CodeBlock(t2=string_from_object, t3=cad_block.OriginPoint)
# ---------- code_block_2.designscript (5 lines) ----------
t1 = "F56";
bool1 = String.Contains(t2, t1, false);
t4 = DSCore.List.FilterByBoolMask(t3, bool1);
t5 = Dictionary.ValueAtKey(t4, "in");
t6 = Dictionary.ValueAtKey(t4, "out");
# ----------------------------------------
levels = Levels()  # nothing selected
byPointAndLevel = FamilyInstance.ByPointAndLevel(familyType=family_types, point=code_block_2.t5, level=levels)
