# Dynamo graph Pipe Slope QC.dyn (Dynamo 2.3.0.5885)

categories = Categories("OST_PipeCurves")
all_elements_of_category = ElementsOfCategory(Category=categories)
string = StringInput("Comments")
string_2 = StringInput("Slope")
getParameterValueByName = Element.GetParameterValueByName(element=all_elements_of_category, parameterName=string_2)
string_from_object = FromObject(obj=getParameterValueByName)
setParameterByName = Element.SetParameterByName(element=all_elements_of_category, parameterName=string, value=string_from_object)
