# Dynamo graph Pipe Slope Schedule.dyn (Dynamo 2.3.0.5885)

categories = Categories("OST_PipeCurves")
code_block = CodeBlock { "Pipe Slope"; }
schedule_type = ScheduleTypes("RegularSchedule")
createSchedule = ScheduleView.CreateSchedule(category=categories, name=code_block, scheduleType=schedule_type)
schedulableFields = ScheduleView.SchedulableFields(scheduleView=createSchedule)
string_from_object = FromObject(obj=schedulableFields)
code_block_2 = CodeBlock { "Family and Type"; }
contains = String.Contains(str=string_from_object, searchFor=code_block_2)
filterByBoolMask = List.FilterByBoolMask(list=schedulableFields, mask=contains)
code_block_3 = CodeBlock(list=filterByBoolMask.in) { list[0]; }
string_from_object_2 = FromObject(obj=schedulableFields)
code_block_4 = CodeBlock { "System Type"; }
contains_2 = String.Contains(str=string_from_object_2, searchFor=code_block_4)
filterByBoolMask_2 = List.FilterByBoolMask(list=schedulableFields, mask=contains_2)
code_block_5 = CodeBlock(list=filterByBoolMask_2.in) { list[0]; }
string_from_object_3 = FromObject(obj=schedulableFields)
code_block_6 = CodeBlock { "Comments"; }
contains_3 = String.Contains(str=string_from_object_3, searchFor=code_block_6)
filterByBoolMask_3 = List.FilterByBoolMask(list=schedulableFields, mask=contains_3)
code_block_7 = CodeBlock(list=filterByBoolMask_3.in) { list[0]; }
join = List.Join(list0=code_block_3, list1=code_block_5, list2=code_block_7)
addFields = ScheduleView.AddFields(scheduleView=createSchedule, fields=join)
