# Dynamo graph Prefix + Unique Number.dyn (Dynamo 2.3.0.5885)

# note: Contact - premtalreja7@gmail.com for any queries
select_model_elements = DSModelElementsSelection()  # 12 picked in the model; graph input
create = List.Create(item0=select_model_elements)
flatten = List.Flatten(list=create)
parameter_name = StringInput("Comments")  # graph input
prefix = StringInput("0")  # graph input
number = StringInput("10000")  # graph input
toNumber = String.ToNumber(str=number)
code_block = CodeBlock(B=toNumber) { 1..B; }
string_from_object = FromObject(obj=code_block)
number_length = StringInput("4")  # graph input
toNumber_2 = String.ToNumber(str=number_length)
code_block_2 = CodeBlock { "0"; }
padLeft = String.PadLeft(str=string_from_object, newWidth=toNumber_2, padChars=code_block_2)
add = prefix + padLeft
setParameterByName = Element.SetParameterByName(element=flatten, parameterName=parameter_name, value=add)
