# Dynamo graph Room Dimension Update.dyn "Room_ Dimension" (Dynamo 2.3.0.5885)

# note: Contact - premtalreja7@gmail.com for any queries
categories = Categories("OST_Rooms")
all_elements_of_category = ElementsOfCategory(Category=categories)
code_block = CodeBlock { "Comments"; }
boundingBox = Element.BoundingBox(element=all_elements_of_category)
minPoint = BoundingBox.MinPoint(boundingBox=boundingBox)
X = Point.X(point=minPoint)
maxPoint = BoundingBox.MaxPoint(boundingBox=boundingBox)
X_2 = Point.X(point=maxPoint)
code_block_2 = CodeBlock(A=X, B=X_2) { A-B; }
round = Math.Round(number=code_block_2)
floor = Math.Floor(number=round)
string_from_object = FromObject(obj=floor)
code_block_3 = CodeBlock { "-"; }
split = String.Split(str=string_from_object, separator0=code_block_3)
# note: Custom Node: Geometry
Y = Point.Y(point=minPoint)
Y_2 = Point.Y(point=maxPoint)
code_block_4 = CodeBlock(A=Y, B=Y_2) { A-B; }
round_2 = Math.Round(number=code_block_4)
floor_2 = Math.Floor(number=round_2)
string_from_object_2 = FromObject(obj=floor_2)
code_block_5 = CodeBlock { "-"; }
split_2 = String.Split(str=string_from_object_2, separator0=code_block_5)
code_block_6 = CodeBlock(A=split, B=split_2) { A+" x "+B; }
setParameterByName = Element.SetParameterByName(element=all_elements_of_category, parameterName=code_block, value=code_block_6)
