# Dynamo graph Room Missing Warning.dyn "Room_ Missing_Warning" (Dynamo 2.13.1.3887)

# group: Room_ Missing_Warning
# note: Contact - premtalreja7@gmail.com for any queries

categories = Categories("OST_Rooms")
all_elements_of_category = ElementsOfCategory(Category=categories)
area = Room.Area(room=all_elements_of_category)
code_block = CodeBlock { 0; }
eq = area == code_block
filterByBoolMask = List.FilterByBoolMask(list=all_elements_of_category, mask=eq)
delete = Element.Delete(element=filterByBoolMask.in)
