# Dynamo graph Scan On-Off.dyn (Dynamo 2.3.0.5885)

# note: Contact premtalreja7@gmail.com in case of any queries
current = Document.Current()
activeView = Document.ActiveView(document=current)
categories = Categories("OST_PointClouds")
byProperties = Revit.Filter.OverrideGraphicSettings.ByProperties()
boolean = BoolSelector(false)
setCategoryOverrides = View.SetCategoryOverrides(view=activeView, category=categories, overrides=byProperties, hide=boolean)
