# Dynamo graph Serial Number By Name.dyn (Dynamo 2.3.0.5885)

# note: Contact premtalreja7@gmail.com in case of queries
select_model_elements = DSModelElementsSelection()  # nothing selected
string = StringInput("")
code_block = CodeBlock { 1..9999; }
string_from_object = FromObject(obj=code_block)
code_block_2 = CodeBlock { 3; }
code_block_3 = CodeBlock { 0; }
padLeft = String.PadLeft(str=string_from_object, newWidth=code_block_2, padChars=code_block_3)
setParameterByName = Element.SetParameterByName(element=select_model_elements, parameterName=string, value=padLeft)
