# Dynamo graph Set Type Parameter By Name.dyn (Dynamo 2.3.0.5885)

select_model_elements = DSModelElementsSelection()  # 3 picked in the model; graph input
elementType = Element.ElementType(element=select_model_elements)
string = StringInput("Type Mark")
set_value = StringInput("Set Value")
setParameterByName = Element.SetParameterByName(element=elementType, parameterName=string, value=set_value)
