# Dynamo graph Slightly Off-Axis_Warning.dyn "Slightly_Off-Axis_Warning_ Resolved_by_ Dynamo" (Dynamo 2.13.1.3887)
# packages: spring nodes 203.2.0

# group: Slightly Off-Axis Warning
# note: Contact - premtalreja7@gmail.com for any queries

boolean = BoolSelector(false)
getWarningsInfo = RevitModel.Warning.GetWarningsInfo(toggle=boolean)
watch = Watch(getWarningsInfo.Failing_Elements)
code_block = CodeBlock { "slightly"; }
contains = String.Contains(string=getWarningsInfo.Warning_Text, searchFor=code_block)
filterByBoolMask = List.FilterByBoolMask(list=watch, mask=contains)
flatten = List.Flatten(list=filterByBoolMask.in)
locationCurve = Elements.Element.LocationCurve(element=filterByBoolMask.in)
midpoint = Geometry.Points.Midpoint(line=locationCurve)
ZAxis = Vector.ZAxis()
angleWithXaxis = Geometry.Curve.AngleWithXaxis(curve=locationCurve)
code_block_2 = CodeBlock { 90; }
lt = angleWithXaxis < code_block_2
code_block_3 = CodeBlock(b=angleWithXaxis) { b-0; }
code_block_4 = CodeBlock(a=angleWithXaxis) { a-90; }
if_ = If(test=lt, true=code_block_3, false=code_block_4)
code_block_5 = CodeBlock { 89; }
gt = if_ > code_block_5
code_block_6 = CodeBlock(b=if_) { b-90; }
code_block_7 = CodeBlock(b=if_) { b-0; }
if_2 = If(test=gt, true=code_block_6, false=code_block_7)
code_block_8 = CodeBlock { 89; }
gt_2 = if_2 > code_block_8
code_block_9 = CodeBlock(b=if_2) { b-90; }
code_block_10 = CodeBlock(b=if_2) { b-0; }
if_3 = If(test=gt_2, true=code_block_9, false=code_block_10)
flatten_2 = List.Flatten(list=if_3)
code_block_11 = CodeBlock(a=flatten_2) { a+0; }
rotate = Geometry.Rotate(geometry=locationCurve, origin=midpoint, axis=ZAxis, degrees=code_block_11)
flatten_3 = List.Flatten(list=rotate)
ꟿ_element_setlocation = Custom[ꟿ Element.SetLocation](element=flatten, location=flatten_3)  # package spring nodes; Attempts to modify the location of the input element. This can effectively add as a move comand in Revit. Works for both line based and point based elements.
boolean_2 = BoolSelector(true)
set_walljoin = Custom[Set WallJoin](Elements=ꟿ_element_setlocation, Bool=boolean_2)
