# Dynamo graph Topography_Scan to BIM.dyn (Dynamo 2.1.0.7500)

# group: Inputs
number_of_points = DoubleSlider(2000, range=1000..100000 step 500)  # graph input
pc_select_points_by_region = Custom[❄_PC_Select_Points_By_Region](PointSampleSize=number_of_points)  # (Sastrugi_Pointcloud_Geometry) This node allows users to select a specific number of Pointcloud Points by creating a selection region in the Active View.

# group: Points Processing and topography creation
python_script = Python(IN[0]=pc_select_points_by_region.OutputPoints)
# ---------- python_script.python (43 lines) ----------
import clr
import math
from collections import deque

# Import Revit and Dynamo libraries
clr.AddReference('RevitAPI')
clr.AddReference('RevitServices')
from Autodesk.Revit.DB import *
from RevitServices.Persistence import DocumentManager
from RevitServices.Transactions import TransactionManager

# The input 'points' should be a list of XYZ points (you need to provide this in Dynamo)
points = IN[0]  # Input: List of XYZ points

# Function to calculate the Euclidean distance between two points
def calculate_distance(p1, p2):
    return math.sqrt((p1.X - p2.X)**2 + (p1.Y - p2.Y)**2 + (p1.Z - p2.Z)**2)

# Function to calculate the average height of the nearest 10 points
def average_height_of_nearest_points(points, idx, num_neighbors=10):
    distances = []
    for i, p in enumerate(points):
        if i != idx:  # Skip the point itself
            dist = calculate_distance(points[idx], p)
            distances.append((dist, p))  # Store distance with the point
    # Sort by distance and get the nearest 'num_neighbors' points
    distances.sort(key=lambda x: x[0])
    nearest_points = [pt[1] for pt in distances[:num_neighbors]]
    # Calculate the average height (Z-coordinate) of the nearest points
    avg_height = sum([pt.Z for pt in nearest_points]) / len(nearest_points)
    return avg_height

# Output list for points that meet the condition
output_points = []

# Iterate through each point and check the condition
for i, point in enumerate(points):
    avg_height = average_height_of_nearest_points(points, i)
    if point.Z <= avg_height:
        output_points.append(point)

# Return the result as the output
OUT = output_points
# ----------------------------------------
byPoints = Topography.ByPoints(points=python_script)
