# Dynamo graph Unjoined ElementR24.dyn (Dynamo 2.17.0.3472)

# group: Script Information
# note: CREATED BY: Chirag Savaliya
# CREATED: 24/10/2024
# VERSION: V 0.1
# LAST EDITED: 24/10/2024
# DYNAMO VERSION: It supports all Dynamo Versions in Revit 2020 to Present.
# PACKAGES:
# NOTES:
# Contact: Savaliya.chirag1998@gmail.com

# group: To get Unjoined Elements
refresh = BoolSelector(true)
python_script = Python(IN[0]=refresh)  # CPython3
# ---------- python_script.python (79 lines) ----------
import clr
clr.AddReference('RevitServices')
clr.AddReference('RevitAPI')
clr.AddReference('RevitNodes')

from RevitServices.Persistence import DocumentManager
from Autodesk.Revit.DB import *
from System.Collections.Generic import List

def get_solids_from_element(element):
    solids = []
    geom_element = element.get_Geometry(Options())
    if geom_element:
        for geom_obj in geom_element:
            if isinstance(geom_obj, Solid) and geom_obj.Volume > 0:
                solids.append(geom_obj)
            elif isinstance(geom_obj, GeometryInstance):
                instance_geometry = geom_obj.GetInstanceGeometry()
                for inst_obj in instance_geometry:
                    if isinstance(inst_obj, Solid) and inst_obj.Volume > 0:
                        solids.append(inst_obj)
    return solids

def check_solid_intersection(solid1, solid2):
    intersection = BooleanOperationsUtils.ExecuteBooleanOperation(solid1, solid2, BooleanOperationsType.Intersect)
    return intersection is not None and intersection.Volume > 0

def get_clashing_elements(doc, category1, category2):
    clashes = []  # Store unique pairs of elements that clash
    collector1 = FilteredElementCollector(doc).OfCategory(category1).WhereElementIsNotElementType()
    collector2 = FilteredElementCollector(doc).OfCategory(category2).WhereElementIsNotElementType()

    for elem1 in collector1:
        solids1 = get_solids_from_element(elem1)
        if len(solids1) == 0:
            continue

        for elem2 in collector2:
            solids2 = get_solids_from_element(elem2)
            if len(solids2) == 0:
                continue

            for solid1 in solids1:
                for solid2 in solids2:
                    if check_solid_intersection(solid1, solid2):
                        if elem1.Id != elem2.Id:  # Ensure not comparing the same element
                            # Ensure the pair (elem1, elem2) is unique by ordering the IDs
                            pair = (elem1, elem2) if elem1.Id.IntegerValue < elem2.Id.IntegerValue else (elem2, elem1)
                            if pair not in clashes:
                                clashes.append(pair)  # Add unique pair
    return clashes

def get_clashing_pairs(doc, categories):
    all_clashes = []
    for i in range(len(categories)):
        for j in range(i, len(categories)):
            clashes = get_clashing_elements(doc, categories[i], categories[j])
            all_clashes.extend(clashes)
    return all_clashes

def join_geometry_clashes(doc):
    categories_to_check = List[BuiltInCategory]()
    categories_to_check.Add(BuiltInCategory.OST_Walls)
    categories_to_check.Add(BuiltInCategory.OST_Floors)
    categories_to_check.Add(BuiltInCategory.OST_StructuralFraming)
    categories_to_check.Add(BuiltInCategory.OST_Roofs)

    try:
        clashes = get_clashing_pairs(doc, categories_to_check)
        return clashes  # Return the list of unique clashing elements
    except Exception as ex:
        return str(ex)

# Access the active document in Dynamo
doc = DocumentManager.Instance.CurrentDBDocument
clashing_elements = join_geometry_clashes(doc)

# Output: List of unique element pairs that are clashing
OUT = clashing_elements
# ----------------------------------------

# group: Process Elements
uniqueItems = List.UniqueItems(list=python_script)
flatten = List.Flatten(list=uniqueItems)

# group: Create a 3D view
code_block = CodeBlock { "3D view - Unjoined Elements"; }
python_script_2 = Python(IN[0]=code_block)  # CPython3
# ---------- python_script_2.python (50 lines) ----------
import clr
clr.AddReference('RevitServices')
clr.AddReference('RevitAPI')
clr.AddReference('RevitNodes')

from RevitServices.Persistence import DocumentManager
from RevitServices.Transactions import TransactionManager
from Autodesk.Revit.DB import *

# Get the active document
doc = DocumentManager.Instance.CurrentDBDocument

# Input: view name from the user
view_name = IN[0]  # Input view name

# Function to create a 3D view
def create_3d_view(doc, view_name):
    # Check if a 3D view with the given name already exists
    collector = FilteredElementCollector(doc).OfClass(View3D)
    for view in collector:
        if view.Name == view_name:
            return view  # Return the existing view if found

    # Get the default 3D view type
    view_family_type_collector = FilteredElementCollector(doc).OfClass(ViewFamilyType)
    view_family_type = None
    for vft in view_family_type_collector:
        if vft.ViewFamily == ViewFamily.ThreeDimensional:
            view_family_type = vft
            break

    if view_family_type is None:
        raise Exception("No 3D view family type found.")

    # Start a transaction to create the 3D view
    TransactionManager.Instance.EnsureInTransaction(doc)
    
    # Create the 3D view
    new_view = View3D.CreateIsometric(doc, view_family_type.Id)
    new_view.Name = view_name

    TransactionManager.Instance.TransactionTaskDone()
    
    return new_view

# Create or find the 3D view
result_view = create_3d_view(doc, view_name)

# Output the created or found view
OUT = result_view
# ----------------------------------------

# group: Isolate Elements in view
python_script_3 = Python(IN[0]=python_script_2, IN[1]=flatten)  # CPython3
# ---------- python_script_3.python (37 lines) ----------
import clr
clr.AddReference('RevitServices')
clr.AddReference('RevitAPI')
clr.AddReference('RevitNodes')

from RevitServices.Persistence import DocumentManager
from RevitServices.Transactions import TransactionManager
from Autodesk.Revit.DB import *
from System.Collections.Generic import List  # Import List from .NET

# Get the active Revit document
doc = DocumentManager.Instance.CurrentDBDocument

# Input: View and List of Elements
view = UnwrapElement(IN[0])  # Input view (3D view)
elements_to_isolate = [UnwrapElement(e) for e in IN[1]]  # List of elements to isolate

# Check if input view is valid
if not isinstance(view, View3D):
    raise Exception("The input view must be a 3D view.")

# Collect all elements visible in the view
collector = FilteredElementCollector(doc, view.Id).WhereElementIsNotElementType()

# Start a transaction to modify the view
TransactionManager.Instance.EnsureInTransaction(doc)

# Create a set of element IDs to isolate
isolate_ids = List[ElementId]([elem.Id for elem in elements_to_isolate])

# Isolate the elements in the view
view.IsolateElementsTemporary(isolate_ids)

TransactionManager.Instance.TransactionTaskDone()

# Output: Confirmation of isolation
OUT = "Elements isolated in the view"
# ----------------------------------------

# group: Group list
code_block_2 = CodeBlock(Passthrough=uniqueItems, Waitfor=python_script_3) { [Passthrough,Waitfor][0]; }
code_block_3 = CodeBlock { 0; }
getItemAtIndex = List.GetItemAtIndex(list=code_block_2@L2, index=code_block_3)
code_block_4 = CodeBlock { 1; }
getItemAtIndex_2 = List.GetItemAtIndex(list=code_block_2@L2, index=code_block_4)

# group: Join Element
do_yo_want_to_join_elements = BoolSelector(true)  # graph input
code_block_5 = CodeBlock { ""; }
if_ = RefactoredIf(test=do_yo_want_to_join_elements, true=getItemAtIndex, false=code_block_5)
if_2 = RefactoredIf(test=do_yo_want_to_join_elements, true=getItemAtIndex_2, false=code_block_5)

# group: Join the elements to make clear drawing
python_script_4 = Python(IN[0]=if_, IN[1]=if_2)  # CPython3
# ---------- python_script_4.python (47 lines) ----------
import clr
clr.AddReference('RevitAPI')
from Autodesk.Revit.DB import *
from System.Collections.Generic import *
clr.AddReference("RevitServices")
import RevitServices
from RevitServices.Persistence import DocumentManager
from RevitServices.Transactions import TransactionManager

# Get the current document
doc = DocumentManager.Instance.CurrentDBDocument

# Unwrap input elements
items1 = UnwrapElement(IN[0])
items2 = UnwrapElement(IN[1])

# Function to join geometry
def JoinGeometry(doc, item1, item2):
    try:
        # Attempt to join geometry
        JoinGeometryUtils.JoinGeometry(doc, item1, item2)
        return True
    except Exception as e:
        # Log or return error details if needed
        return False

# Start the transaction
TransactionManager.Instance.EnsureInTransaction(doc)

# Perform the join operation based on input types (lists or single elements)
if isinstance(IN[0], list):
    if isinstance(IN[1], list):
        # Both inputs are lists, join corresponding elements
        OUT = [JoinGeometry(doc, x, y) for x, y in zip(items1, items2)]
    else:
        # First input is a list, second is a single element
        OUT = [JoinGeometry(doc, x, items2) for x in items1]
else:
    if isinstance(IN[1], list):
        # First input is a single element, second is a list
        OUT = [JoinGeometry(doc, items1, x) for x in items2]
    else:
        # Both inputs are single elements
        OUT = JoinGeometry(doc, items1, items2)

# Complete the transaction
TransactionManager.Instance.TransactionTaskDone()
# ----------------------------------------
