# Dynamo graph Warning Element Isolate In View.dyn (Dynamo 2.13.1.3887)
# packages: archi-lab.net 2016.13.1, Quasar 2.1.3

file_path = Filename("No file selected.")
parseHtml = Archilab.Grimshaw.Elements.Warning.ParseHtml(filePath=file_path)
# note: Script uploaded by Prem Talreja
# Package used - Archilab
elements = Archilab.Grimshaw.Elements.Warning.Elements(warning=parseHtml)
id = Archilab.Grimshaw.Elements.WarningElement.Id(warningElement=elements)
code_block = CodeBlock { 1; }
flatten = List.Flatten(list=id, amount=code_block)
byElementId = Archilab.Grimshaw.Selection.Select.ByElementId(id=flatten)
activeView = Quasar.ViewUtility.ActiveView()
isolate_in_view = Custom[Isolate in View](Element=byElementId, View=activeView)  # package archi-lab.net; This node will take input of elements and a view to isolate selected elements in a view.
