# Dynamo graph Warning Element Override Color In View.dyn (Dynamo 2.13.1.3887)
# packages: archi-lab.net 2016.13.1

file_path = Filename("No file selected.")
parseHtml = Archilab.Grimshaw.Elements.Warning.ParseHtml(filePath=file_path)
# note: Script uploaded by Prem Talreja
# Package used - Archilab
elements = Archilab.Grimshaw.Elements.Warning.Elements(warning=parseHtml)
id = Archilab.Grimshaw.Elements.WarningElement.Id(warningElement=elements)
code_block = CodeBlock { 1; }
flatten = List.Flatten(list=id, amount=code_block)
byElementId = Archilab.Grimshaw.Selection.Select.ByElementId(id=flatten)
code_block_2 = CodeBlock { 255; }
byARGB = Color.ByARGB(red=code_block_2)
overrideColorInView = Element.OverrideColorInView(element=byElementId, color=byARGB)
