# Dynamo graph Workset_Creation.dyn "Workset Creation" (Dynamo 2.2.1.5175)

# group: Notes
# note: For any query, comments, or if you're interested in creating your own script, please get in touch via email: contact@virtualbuildingstudio.com.

file_path = Filename(".\Book1.xlsx")  # graph input
fromPath = FileObject(path=file_path)  # "File.FromPath"
sheet_name = StringInput("Sheet1")  # graph input
boolean = BoolSelector(false)  # graph input
importExcel = Data.ImportExcel(file=fromPath, sheetName=sheet_name, readAsStrings=boolean)
create = List.Create(item0=importExcel)
flatten = List.Flatten(list=create)
string_from_object = FromObject(obj=flatten)
python_script = Python(IN[0]=string_from_object)
# ---------- python_script.python (26 lines) ----------
# Enable Python support and load DesignScript library
import clr
clr.AddReference('ProtoGeometry')
from Autodesk.DesignScript.Geometry import *
clr.AddReference('RevitAPI')
from Autodesk.Revit.DB import *
clr.AddReference('RevitServices')
import RevitServices
from RevitServices.Persistence import DocumentManager
clr.AddReference("RevitNodes")

doc = DocumentManager.Instance.CurrentDBDocument
# The inputs to this node will be stored as a list in the IN variables.
list = UnwrapElement(IN[0])
w_list = []

for i in list:
    t=Transaction(doc, "Create")
    t.Start()
    s = Workset.Create(doc, i).Name
    w_list.append(s)
    t.Commit()
# Place your code below this line

## Assign your output to the OUT variable.
OUT = w_list
# ----------------------------------------
